# Dynamo graph SnoopByElementId.dyn (Dynamo 2.12.0.5650)
# packages: RevitLookupWpf 2022.0.0

select_model_element = DSModelElementSelection()  # 1 picked in the model
code_block = CodeBlock(x=select_model_element) { x.Id; }
snoopByElementId = Custom[SnoopByElementId](elementids=code_block)  # package RevitLookupWpf; Allow Snoop By Input Is ElementId (integer)
