# Dynamo graph SnoopSurface.dyn (Dynamo 2.12.0.5650)
# packages: RevitLookupWpf 2022.0.0

select_model_element = DSModelElementSelection()  # 1 picked in the model
faces = Element.Faces(element=select_model_element)
snoopFace = Custom[SnoopFace](surface=faces)  # package RevitLookupWpf; Allow User Snoop Current Surface In Dynamo
