# Dynamo custom node Init.dyf (Dynamo 2.12.0.5650)
# category: RevitLookup
# Init Revitlookup Assembly

init_revitlookupwpf = Python()  # IronPython2; unwired: IN[0]
# ---------- init_revitlookupwpf.python (70 lines) ----------
# these commands get executed in the current scope
# of each new shell (but not for canned commands)
import clr
clr.AddReference("RevitAPI")
clr.AddReference("RevitAPIUI")
from Autodesk.Revit.DB import *
from Autodesk.Revit.DB.Architecture import *
from Autodesk.Revit.DB.Analysis import *
from Autodesk.Revit.UI import TaskDialog
from Autodesk.Revit.UI import UIApplication
from Autodesk.Revit.DB import ElementSet, ElementId
clr.AddReference('RevitServices')
import RevitServices
from RevitServices.Persistence import DocumentManager
doc = DocumentManager.Instance.CurrentDBDocument
uidoc=DocumentManager.Instance.CurrentUIApplication.ActiveUIDocument
uiapp = DocumentManager.Instance.CurrentUIApplication
app = DocumentManager.Instance.CurrentUIApplication.Application
def get_selected_elements(doc):
    """API change in Revit 2016 makes old method throw an error"""
    try:
        # Revit 2016
        return [doc.GetElement(id)
                for id in uidoc.Selection.GetElementIds()]
    except:
        # old method
        return list(uidoc.Selection.Elements)


selection = get_selected_elements(doc)
# convenience variable for first element in selection
if len(selection):
    s0 = selection[0]

# ------------------------------------------------------------------------------
exmessage = 'RevitLookup not installed. Visit https://github.com/weianweigan/RevitLookupWpf to install.'

class RevitLookup(object):
    def __init__(self, uiApplication):
        """
        for RevitSnoop to function properly, it needs to be instantiated
        with a reference to the Revit Application object.
        """
        # find the RevitLookup plugin
        try:
            rlapp = [app for app in uiApplication.LoadedApplications
                     if app.GetType().Namespace == 'RevitLookupWpf'
                     and app.GetType().Name == 'RvtAddin'][0]
        except IndexError:
            self.RevitLookup = None
            return exmessage
        # tell IronPython about the assembly of the RevitLookup plugin
        clr.AddReference(rlapp.GetType().Assembly)
        import RevitLookupWpf
        self.RevitLookupWpf = RevitLookupWpf
        self.uiapp = uiApplication
    def IsInstalled(self):
    	try:
        	if not self.RevitLookupWpf:
        		return exmessage
    	except:
    		return exmessage
        return True
    def Snoop(self,obj):
        if self.IsInstalled()== True: 
            form = self.RevitLookupWpf.View.LookupWindow(None)
            form.SetRvtInstance(obj)
            form.Show()
revitlookup = RevitLookup(uiapp)
OUT = revitlookup,revitlookup.IsInstalled()
# ----------------------------------------
code_block = CodeBlock(OUT=init_revitlookupwpf) { OUT[0]; OUT[1]; }
RevitlookupWpf = Output(code_block.out0)
Isinstalled = Output(code_block.out1)
