# Dynamo custom node SnoopCurrentSelection.dyf (Dynamo 2.12.0.5650)
# category: RevitLookup
# Snoop Element Selected In Revit
# packages: RevitLookupWpf 2022.0.0

init = Custom[Init]()  # package RevitLookupWpf; Init Revitlookup Assembly
fresh = Input(fresh: var[]..[] = false)  # input true to snoop
python_script = Python(IN[0]=init.RevitlookupWpf, IN[1]=fresh)  # IronPython2
# ---------- python_script.python (59 lines) ----------
import clr

clr.AddReference('RevitAPI')
from Autodesk.Revit.DB import *
from Autodesk.Revit.DB.Structure import *

clr.AddReference('RevitAPIUI')
from Autodesk.Revit.UI import *

clr.AddReference('System')
from System.Collections.Generic import List

clr.AddReference('RevitNodes')
import Revit
clr.ImportExtensions(Revit.GeometryConversion)
clr.ImportExtensions(Revit.Elements)

clr.AddReference('RevitServices')
import RevitServices
from RevitServices.Persistence import DocumentManager
from RevitServices.Transactions import TransactionManager

import System 
from System.Collections.Generic import *

import sys
sys.path.append(r'C:\Program Files (x86)\IronPython 2.7\Lib')

doc = DocumentManager.Instance.CurrentDBDocument
uidoc=DocumentManager.Instance.CurrentUIApplication.ActiveUIDocument
uiapp = DocumentManager.Instance.CurrentUIApplication
app = DocumentManager.Instance.CurrentUIApplication.Application

def tolist(obj1):
	if hasattr(obj1,'__iter__') : return obj1
	else : return [obj1]
# toList = lambda x : x if hasattr(x, '__iter__') else [x]
# element = toList(UnwrapElement(IN[0]))
def flatten(x):
    result = []
    for el in x:
        if hasattr(el, "__iter__") and not isinstance(el, basestring):
            result.extend(flatten(el))
        else:
            result.append(el)
    return result
revitlookup = IN[0]
selectElemId = uidoc.Selection.GetElementIds()
selectElem = [doc.GetElement(xId) for xId in selectElemId]
flag = IN[1]
if flag:
	if len(selectElem) ==0:
		OUT = False
	elif len(selectElem) == 1:
		OUT = revitlookup.Snoop(selectElem[0])
	else:
		OUT = revitlookup.Snoop(selectElem)
else:
	OUT = False
# ----------------------------------------
